# Grasshopper definition Testing.gh (Grasshopper 1.0.8)

xy = XYPlane(Origin=Point(0, 0, 0))
X = UnitX(Factor="-5")
yz = YZPlane(Origin=Point(0, 0, 0))
move = Move(Geometry=xy, Motion=X)  # -> Geometry, Transform
X_2 = XSize(Domain(-1, 1))
prot = RotatePlane(Plane=move.Geometry, Angle=Slider(6.283, range=0..6.283))
rotate = Rotate(Geometry=prot, Angle=Slider(3.121, range=0..6.283), Plane=yz)  # -> Geometry, Transform
xz = XZPlane(Origin=Point(0, 0, 0))
vec = VectorXYZ(XComponent=Slider(1, range=0..1), YComponent=Slider(0, range=0..1), ZComponent=Slider(0.54, range=0..1))  # -> Vector, Length
rotate_2 = Rotate(Geometry=xz, Angle=Slider(0, range=0..6.283), Plane=PlaneXY(0, 0, 0))  # -> Geometry, Transform
rectangle = Rectangle(Plane=rotate.Geometry, XSize=X_2, YSize=X_2, Radius=0)  # -> Rectangle, Length
prot_2 = RotatePlane(Plane=rotate_2.Geometry, Angle=Slider(0, range=0..6.283))
move_2 = Move(Geometry=prot_2, Motion=vec.Vector)  # -> Geometry, Transform
explode = Explode(Curve=rectangle.Rectangle, Recursive=True)  # -> Segments, Vertices
xz_2 = XZPlane(Origin=Point(0, 0, 0))
xy_2 = XYPlane(Origin=Point(0, 0, 0))
item = ListItem(List=explode.Vertices, Index=0, Wrap=True)  # -> Item, Item1, Item2, Item3
midpt = CurveMiddle(Curve=explode.Segments)
sqgrid = Square(Plane=xz, Size=1, ExtentX=5, ExtentY=5)  # -> Cells, Points
rotate_3 = Rotate(Geometry=xy_2, Angle=Slider(2.092, range=0..6.283), Plane=xz_2)  # -> Geometry, Transform
pt = ConstructPoint(XCoordinate=0, YCoordinate=0, ZCoordinate=0)
vec_2 = VectorXYZ(XComponent=Slider(0, range=0..1), YComponent=Slider(0.81, range=0..1), ZComponent=Slider(0.3, range=0..1))  # -> Vector, Length
item_2 = ListItem(List=midpt, Index=0, Wrap=True)  # -> Item, Item1, Item2, Item3
data = Data(sqgrid.Points)
prot_3 = RotatePlane(Plane=rotate_3.Geometry, Angle=Slider(0, range=0..6.283))
vdis = VectorDisplay(Anchor=pt, Vector=vec_2.Vector)
Y = UnitY(Factor="10")
merge = Merge(
    Data1=item.Item,
    Data2=item_2.Item,
    Data3=item.Item1,
    Data4=item_2.Item3,
    Data5=item_2.Item1,
    Data6=item.Item3,
    Data7=item_2.Item2,
    Data8=item.Item2)
X_3 = UnitX(Factor=1)
Y_2 = UnitY(Factor="1.5")
panel = Panel(data)
c_script = CSharpScript(x=data, y=move_2.Geometry)  # -> out, a; inputs x: Point3d, y: Plane
# ---------- c_script: C# ----------
// Grasshopper Script Instance
#region Usings
using System;
using System.Linq;
using System.Collections;
using System.Collections.Generic;
using System.Drawing;

using Rhino;
using Rhino.Geometry;

using Grasshopper;
using Grasshopper.Kernel;
using Grasshopper.Kernel.Data;
using Grasshopper.Kernel.Types;
#endregion

public class Script_Instance : GH_ScriptInstance
{
    #region Notes
    /* 
      Members:
        RhinoDoc RhinoDocument
        GH_Document GrasshopperDocument
        IGH_Component Component
        int Iteration

      Methods (Virtual & overridable):
        Print(string text)
        Print(string format, params object[] args)
        Reflect(object obj)
        Reflect(object obj, string method_name)
    */
    #endregion

    private void RunScript(Point3d x, Plane y, ref object a)
    {
        // Write your logic here
        Plane elementPlane = y;
        Point3d p1 = x;
        Point3d P1 = p1;
        elementPlane.RemapToPlaneSpace(p1, out P1);
        a= P1;
    }
}
# ---------- end c_script ----------
move_3 = Move(Geometry=pt, Motion=Y)  # -> Geometry, Transform
dup = DuplicateData(Data=X_3, Number=Slider(4, range=0..10), Order=True)
points = PointList(Points=merge)
dup_2 = DuplicateData(Data=Y_2, Number=Slider(8, range=0..10), Order=True)
c_script_2 = CSharpScript(x=vec_2.Vector, y=prot_3)  # -> out, a; inputs x: Vector3d, y: Plane
# ---------- c_script_2: C# ----------
// Grasshopper Script Instance
#region Usings
using System;
using System.Linq;
using System.Collections;
using System.Collections.Generic;
using System.Drawing;

using Rhino;
using Rhino.Geometry;

using Grasshopper;
using Grasshopper.Kernel;
using Grasshopper.Kernel.Data;
using Grasshopper.Kernel.Types;
#endregion

public class Script_Instance : GH_ScriptInstance
{
    #region Notes
    /* 
      Members:
        RhinoDoc RhinoDocument
        GH_Document GrasshopperDocument
        IGH_Component Component
        int Iteration

      Methods (Virtual & overridable):
        Print(string text)
        Print(string format, params object[] args)
        Reflect(object obj)
        Reflect(object obj, string method_name)
    */
    #endregion

    private void RunScript(Vector3d x, Plane y, ref object a)
    {
        // Write your logic here
        Plane plane = y;
        Vector3d vector = x;
        a = new Vector3d(vector * plane.XAxis, vector * plane.YAxis, vector * plane.ZAxis);
    }
}
# ---------- end c_script_2 ----------
points_2 = PointList(Points=c_script.a)
merge_2 = Merge(Data1=dup_2, Data2=dup)
panel_2 = Panel(c_script_2.a)
vdis_2 = VectorDisplay(Anchor=move_3.Geometry, Vector=c_script_2.a)
c_script_3 = CSharpScript(p=merge, u=dup_2)  # -> out, P, U; inputs p: list of Point3d, u: list of Vector3d
# ---------- c_script_3: C# ----------
// Grasshopper Script Instance
#region Usings
using System;
using System.Linq;
using System.Collections;
using System.Collections.Generic;
using System.Drawing;

using Rhino;
using Rhino.Geometry;

using Grasshopper;
using Grasshopper.Kernel;
using Grasshopper.Kernel.Data;
using Grasshopper.Kernel.Types;
#endregion

public class Script_Instance : GH_ScriptInstance
{
    #region Notes
    /* 
      Members:
        RhinoDoc RhinoDocument
        GH_Document GrasshopperDocument
        IGH_Component Component
        int Iteration

      Methods (Virtual & overridable):
        Print(string text)
        Print(string format, params object[] args)
        Reflect(object obj)
        Reflect(object obj, string method_name)
    */
    #endregion

     //Properties___________________________________________________________________________________________________________________________________________________

    public Vector3d U1;
    public Vector3d U2;
    public Vector3d U3;
    public Vector3d U4;
    public Vector3d U5;
    public Vector3d U6;
    public Vector3d U7;
    public Vector3d U8;
    public Point3d P1;
    public Point3d P2;
    public Point3d P3;
    public Point3d P4;
    public Point3d P5;
    public Point3d P6;
    public Point3d P7;
    public Point3d P8;
    public double v;

    public int Direction;

    private double ξ;
    private double η;
    public Point3d NaturalCoordinate
    {
        get { return new Point3d(ξ, η, 0.0); }
        set
        {
            ξ = value.X;
            η = value.Y;
        }
    }

    private void RunScript(
		List<Point3d> p,
		List<Vector3d> u,
		ref object P,
		ref object U)
    {
        // Calculate the element plane
        Point3d p1 = p[0];
        Point3d p2 = p[1];
        Point3d p3 = p[2];
        Point3d p4 = p[3];
        Point3d p5 = p[4];
        Point3d p6 = p[5];
        Point3d p7 = p[6];
        Point3d p8 = p[7];
        
        Vector3d u1 = u[0];
        Vector3d u2 = u[1];
        Vector3d u3 = u[2];
        Vector3d u4 = u[3];
        Vector3d u5 = u[4];
        Vector3d u6 = u[5];
        Vector3d u7 = u[6];
        Vector3d u8 = u[7];


        Plane elementPlane = new Plane(p1, p3 - p1, p6 - p1);

        // Remap the points P1 to P8 from the world plane to the element plane
        elementPlane.RemapToPlaneSpace(p1, out P1);
        elementPlane.RemapToPlaneSpace(p2, out P2);
        elementPlane.RemapToPlaneSpace(p3, out P3);
        elementPlane.RemapToPlaneSpace(p4, out P4);
        elementPlane.RemapToPlaneSpace(p5, out P5);
        elementPlane.RemapToPlaneSpace(p6, out P6);
        elementPlane.RemapToPlaneSpace(p7, out P7);
        elementPlane.RemapToPlaneSpace(p8, out P8);


        // Update the coordinates of U1 to U8 to reference the new plane
        U1 = projectVector(u1, elementPlane);
        U2 = projectVector(u2, elementPlane);
        U3 = projectVector(u3, elementPlane);
        U4 = projectVector(u4, elementPlane);
        U5 = projectVector(u5, elementPlane);
        U6 = projectVector(u6, elementPlane);
        U7 = projectVector(u7, elementPlane);
        U8 = projectVector(u8, elementPlane);

        v = 0.0;
        Direction = 0;


        P = new List<Point3d>{P1,P2,P3,P4,P5,P6,P7,P8};
        U = new List<Vector3d>{U1,U2,U3,U4,U5,U6,U7,U8};

    }

    private Vector3d projectVector(Vector3d vector, Plane plane)
    {
        return new Vector3d(vector * plane.XAxis, vector * plane.YAxis, vector * plane.ZAxis);
    }

}
# ---------- end c_script_3 ----------
vdis_3 = VectorDisplay(Anchor=merge, Vector=dup_2)
vdis_4 = VectorDisplay(Anchor=c_script_3.P, Vector=c_script_3.U)
vlen = VectorLength(Vector=c_script_3.U)
panel_3 = Panel(vlen)
